# Grasshopper definition Gh_src_D1_20171215.gh (Grasshopper 0.9.76)
# plug-ins: LunchBox

# ----
# Inputs
fadeing_distance = Slider(167.77, range=0..715)
max_radius = Slider(0.802, range=0..1)
number_slider = Slider(57, range=0..100)
number_slider_2 = Slider(41, range=0..100)
main_scale = Slider(0.39, range=0.001..3)
base_surface = Surface(reparameterize(<surface referenced from the Rhino model>))
shape_curve = Curve(<curve referenced from the Rhino model>)

controll_curve = Curve(<curve referenced from the Rhino model>)

# ----
# Hexagon grid
v_count = Number(number_slider)
u_count = Number(number_slider_2)
base_surface_2 = Surface(base_surface)
hex = HexagonCells(Surface=base_surface_2, UDivisions=u_count, VDivisions=v_count, TParameter=0.25)  # -> HexagonCells, Centers
point_on_srf = Point(hex.Centers)

# ----
# Rectangle grid
v_count_2 = Number(number_slider)
base_surface_3 = Surface(base_surface)
u_count_2 = Number(number_slider_2)
range = Range(Domain=Domain(0, 1), Steps=v_count_2)
range_2 = Range(Domain=Domain(0, 1), Steps=u_count_2)
crossref = CrossReference(ListA=range_2, ListB=range, CrossMode=1)  # -> ListA, ListB
pt = ConstructPoint(XCoordinate=crossref.ListA, YCoordinate=crossref.ListB, ZCoordinate=0)
evalsrf = EvaluateSurface(Surface=base_surface_3, Point=pt)  # -> Point, Normal, Frame
point_on_srf_2 = Point(evalsrf.Point)
frame_on_srf = Plane(evalsrf.Frame)

# ----
# Point to Frame
base_surface_4 = Surface(base_surface)
point_on_srf_3 = Point(point_on_srf)
srf_cp = SurfaceClosestPoint(Point=point_on_srf_3, Surface=base_surface_4)  # -> Point, UVPoint, Distance
evalsrf_2 = EvaluateSurface(Surface=base_surface_4, Point=srf_cp.UVPoint)  # -> Point, Normal, Frame
frame_on_srf_2 = Plane(evalsrf_2.Frame)

frame = Plane(frame_on_srf_2)
crv = Curve(<curve referenced from the Rhino model>)

# ----
# Distance to curve & edge
frame_on_srf_3 = Plane(simplify(frame))
base_surface_5 = Surface(base_surface)
border_curve = Curve(controll_curve)
edges = BrepEdges(Brep=base_surface_5)  # -> Naked, Interior, NonManifold
join = JoinCurves(Curves=edges.Naked, Preserve=False)

fading_curves = Curve(graft([crv, border_curve]))

crv_cp = CurveClosestPoint(Point=frame_on_srf_3, Curve=fading_curves)  # -> Point, Parameter, Distance
distance = Number(crv_cp.Distance)

# ----
# Find lowest distance
distances = Number(distance)
bang = ExplodeTree(Data=distances)  # -> Branch0, Branch1
min = Minimum(A=bang.Branch0, B=bang.Branch1)
distance_2 = Number(min)

# ----
# Tag rounded
frame_on_srf_4 = Plane(frame)
distance_3 = Number(distance_2)
round = Round(Number=distance_3)  # -> Nearest, Floor, Ceiling
tag = TextTag3D(Location=frame_on_srf_4, Text=round.Nearest, Size=1)

# ----
# Remap distance
# Old version needs min
fadeing_distance_2 = Number(fadeing_distance)
max_radius_2 = Number(max_radius)
distance_4 = Number(distance_2)
dom = ConstructDomain(DomainStart=Slider(27.346, range=0..100), DomainEnd=fadeing_distance_2)
dom_2 = ConstructDomain(DomainStart=0, DomainEnd=max_radius_2)
remap = RemapNumbers(Value=distance_4, Source=dom, Target=dom_2)
min_2 = Minimum(A=max_radius_2, B=remap)

max = Maximum(A=min_2, B=Slider(0, range=0..100))

radius = Number(max)

# ----
# Scale Curve
shape_curve_2 = Curve(shape_curve)
main_scale_2 = Number(main_scale)
controled_scale = Number(radius)
area = Area(Geometry=shape_curve_2)  # -> Area, Centroid
multiplication = Multiplication(A=main_scale_2, B=controled_scale)
scale = Scale(Geometry=shape_curve_2, Center=area.Centroid, Factor=multiplication)  # -> Geometry, Transform

shape_curve_3 = Curve(scale.Geometry)
source_point = Point(area.Centroid)
target_point = Point(frame)
vec2pt = Vector2Pt(PointA=source_point, PointB=target_point, Unitize=False)  # -> Vector, Length
move = Move(Geometry=shape_curve_3, Motion=vec2pt.Vector)  # -> Geometry, Transform

frame_on_srf_5 = Plane(frame_on_srf_3)
radius_2 = Number(radius)
cir = Circle(Plane=frame_on_srf_5, Radius=radius_2)
